# Grasshopper definition SynapseExample.gh (Grasshopper 1.0.7)
# plug-ins: Synapse

panel = Panel("""DecimalPlaces
Increment""")
argb = SplitARGB(Colour=ColourSwatch(SwatchColor=RGB(50, 132, 209)), IntegerChannels=True)  # -> Alpha, Red, Green, Blue
panel_2 = Panel("""sliderwidth
maxvalue
minvalue
steps""")

# ---- group: stack properties
D = Slider(5, range=5..20)
D_2 = Slider(10, range=5..20)
size = SynapseSize(Width=Slider(260, range=100..800), Height=Slider(200, range=100..800))
int = Integer(D)
int_2 = Integer(D_2)

# ----
scolor = SynapseColor(Alpha=argb.Alpha, Red=argb.Red, Green=argb.Green, Blue=argb.Blue)
sdm = SynapseDropMenu(Options=flatten(["Alpha", "Beta", "Omega"]))  # -> AllProperties, Control
sfont = SynapseFont(FontFamily="Lucida Console", FontSize=8.25, FontStyle=0, Decoration=0)
panel_3 = Panel("""2
2""")
panel_4 = Panel("""115
0.8
0.2
5""")
scombo = SynapseComboBox(Options=flatten(["Alpha", "Beta", "Omega"]))  # -> AllProperties, Control
stb = SynapseTextBox(Mask="(000) 000 0000")  # -> AllProperties, Control, AllMasks
genes = GenePool(Decimals=0, Maximum=99, Minimum=1, Value=[35.98291824, 41, 36, 72])
genes_2 = GenePool(Decimals=0, Maximum=99, Minimum=1, Value=[75, 40, 74, 74])
int_3 = Integer(panel_3)
panel_5 = Panel("""Some option A
A better option B
Another option C
Last option D""")
ss = SynapseSlider(Property=flatten(panel_2), PropertyValue=flatten(panel_4), Coefficient=0.01)  # -> AllProperties, Control
slbl = SynapseLabel(Property=flatten("text"), PropertyValue=flatten("object name"))  # -> AllProperties, Control
stb_2 = SynapseTextBox(Property=flatten("TextColor"), PropertyValue=flatten(scolor))  # -> AllProperties, Control
sbtn = SynapseButton(Property=flatten("Font"), PropertyValue=flatten(sfont))  # -> AllProperties, Control
snud = SynapseNumUpDn(Property=flatten(panel), PropertyValue=flatten(int_3))  # -> AllProperties, Control
scb = SynapseCheckBox(Property=flatten("TextColor"), PropertyValue=flatten(ColourSwatch(SwatchColor=RGB(178, 43, 154))))  # -> AllProperties, Control
panel_6 = Panel("""Size
Spacing""")
genes_3 = GenePool(Decimals=0, Maximum=99, Minimum=1, Value=[19, 19, 21, 31])
genes_4 = GenePool(Decimals=0, Maximum=99, Minimum=1, Value=[31, 16, 32, 20])
int_4 = Integer("200")
X = Slider(26, range=1..50, expression="x*10")
smt = SynapseMultiTexts(Property=flatten("Width"), PropertyValue=flatten(int_4))  # -> AllProperties, Control; disabled
pickone = SynapseSingleSelect(Options=flatten(panel_5))  # -> AllProperties, Control
slb = SynapseListBox(Options=flatten(["Alpha", "Beta", "Omega"]))  # -> AllProperties, Control
sstack = SynapseStack(
    Property=flatten(panel_6),
    PropertyValue=flatten([size, int]),
    Controls=flatten([scombo.Control, sdm.Control, stb.Control]))  # -> AllProperties, Control
D_3 = Slider(14, range=5..20)
merge = Merge(Data1=graft(genes_3), Data2=graft(genes), Data3=graft(genes_2), Data4=graft(genes_4))
merge_2 = Merge(
    Data1=Slider(11, range=1..99),
    Data2=Slider(47, range=1..99),
    Data3=Slider(17, range=1..99),
    Data4=Slider(25, range=1..99))
sxpdr = SynapseExpander(Property=flatten("Expanded"), PropertyValue=flatten(Toggle(True)), Controls=flatten(pickone.Control))  # -> AllProperties, Control; disabled
panel_7 = Panel("""Orientation
Size
Spacing""")
merge_3 = Merge(Data1=flatten("horizontal"), Data2=flatten(size), Data3=flatten(int))
flip = FlipMatrix(Data=merge)  # -> simplify(Data)
merge_4 = Merge(
    Data1=ColourSwatch(SwatchColor=RGB(166, 235, 117)),
    Data2=ColourSwatch(SwatchColor=RGB(232, 32, 32)),
    Data3=ColourSwatch(SwatchColor=RGB(237, 217, 64)),
    Data4=ColourSwatch(SwatchColor=RGB(122, 134, 230)))
int_5 = Integer(X)
# some properties won't convert data type automatically;
# manually enforce the integer type
int_6 = Integer(D_3)
complex = CreateComplex(Real=Slider(146, range=50..200), Imaginary=Slider(90, range=50..200))
series = Series(Start=0, Step=1, Count="4")
merge_5 = Merge(
    Data1=flatten(scb.Control),
    Data2=flatten(sbtn.Control),
    Data3=flatten(slbl.Control),
    Data4=flatten(snud.Control),
    Data5=flatten(ss.Control),
    Data6=flatten(stb_2.Control))
merge_6 = Merge(Data1=flatten(int_6), Data2=flatten(int_6), Data3=flatten(int_5))
sstack_2 = SynapseStack(Property=flatten(panel_7), PropertyValue=flatten(merge_3), Controls=flatten([slb.Control, sstack.Control]))  # -> AllProperties, Control
panel_8 = Panel("""Size
Padding
Spacing""")
panel_9 = Panel("""padding
spacing
Width""")
txy = SynapseTableXY(Controls=merge_5, Columns=2)  # -> Coordinates, Dimensions
table = SynapseTable(
    Property=flatten(panel_9),
    PropertyValue=flatten(merge_6),
    Controls=flatten(merge_5),
    ControlLocation=flatten(txy.Coordinates),
    TableDimension=txy.Dimensions)  # -> AllProperties, Control
sstack_3 = SynapseStack(Property=flatten(panel_8), PropertyValue=flatten([size, int_2, int]), Controls=flatten(sstack_2.Control))  # -> AllProperties, Control
strends = SynapseTrends(Size=complex, Numbers=flip, Name=graft(series), Color=graft(merge_4))  # -> ChartObject, ChartData
shisto = SynapseHistogram(Size=complex, Numbers=merge_2, Colors=merge_4)  # -> ChartObject, ChartData
spie = SynapsePieChart(Size=complex, Numbers=merge_2, Colors=merge_4)  # -> ChartObject, ChartData
shrrchy = SynapseHierarchy(Size=complex, Numbers=merge_2, Colors=merge_4)  # -> ChartObject, ChartData
Y = Slider(29, range=1..50, expression="x*10")
X_2 = Slider(30, range=1..50, expression="x*10")
padding = Slider(5, range=1..15)
panel_10 = Panel("""Apple
Banana
Cantaloupe""")
legend = SynapsePieLegend(Property=flatten("Marker"), PropertyValue=flatten("bullet"), PieData=shrrchy.ChartData)  # -> AllProperties, Legend
int_7 = Integer("1")
vec = VectorXYZ(XComponent=X_2, YComponent=Y, ZComponent=0)  # -> Vector, Length
resizable = BooleanToggle(False)
topmost = BooleanToggle(True)
pypt = GhPythonScript(x=Slider(1, range=1..50, expression="x*10"), y=Slider(4, range=1..50, expression="x*10"))  # -> out, p; inputs x: Int32, y: Int32
# ---------- pypt: Python ----------
"""creating an Eto.Drawing.Point object for Synapse plugin to consume.
    Inputs:
        x: x coordinate
        y: y coordinate
    Output:
        p: point object"""

__author__ = "wwang"
__version__ = "2021.02.19"

import Eto.Drawing as drw

p = drw.Point(x,y)
# ---------- end pypt ----------
int_8 = Integer(padding)
sdlo = SynapseDynamicLayout(Controls=flatten([shrrchy.ChartObject, legend.Legend]))  # -> AllProperties, Control
sstack_4 = SynapseStack(
    Property=flatten(panel_8),
    PropertyValue=flatten([size, int_2, int]),
    Controls=flatten([smt.Control, sxpdr.Control, sdlo.Control]))  # -> AllProperties, Control
merge_7 = Merge(Data1=flatten(table.Control), Data2=flatten(sstack_4.Control), Data3=flatten(sstack_3.Control))
tab = SynapseTabs(Property=flatten("SelectedIndex"), PropertyValue=flatten(int_7), Controls=flatten(merge_7), TabName=flatten(panel_10))  # -> AllProperties, Control
merge_8 = Merge(
    Data1=flatten(scolor),
    Data2=flatten("NimbleDashboard"),
    Data3=flatten(pypt.p),
    Data4=flatten(vec.Vector),
    Data5=flatten(topmost),
    Data6=flatten(int_8),
    Data7=flatten(resizable))
panel_11 = Panel("""color
title
Location
size
Topmost
Padding
Resizable""")
showwindow = BooleanToggle(False)
swindow = SynapseWindow(
    Show=showwindow,
    Property=flatten(panel_11),
    PropertyValue=flatten(merge_8),
    Contents=flatten(tab.Control),
    ctrlfill=False,
    ctrlredo=True)
